# Grasshopper definition CirclePacking Algorithm.gh (Grasshopper 0.9.76)

c_script = CSharpScript(
    reset=Button(),
    play=Toggle(False),
    scale=Slider(5, range=1..10),
    length=Slider(1754, range=0..6000),
    width=Slider(1240, range=0..6000),
    growingSpeed=Slider(1.335, range=0.1..2),
    density=Slider(2, range=1..10))  # -> out, circles_A, swatch, C, D; inputs reset: Boolean, play: Boolean, scale: Int32, length: Int32, width: Int32, growingSpeed: Double, density: Int32
# ---------- c_script: C# ----------
    cR = new List<Circle>();
    Rectangle3d rec = new Rectangle3d(Plane.WorldXY, new Interval(-length, length), new Interval(-width, width));

    List<Circle> colorCircles = new List<Circle>();

    int total = density;
    int count = 0;
    // int attempts = 0;
    if(reset || circles == null)
    {
      circles = new List<CirclePack>(); //initiate the list
    }
    else
    {
      while(count < total)
      {
        CirclePack cpack = newCircle(length, width, growingSpeed);
        if(cpack != null)
        {
          circles.Add(cpack);
          count++;
        }
        /*
        attempts++;
        if(attempts > trial)
        {
          Print("WE ARE DONE!");
          break;
        }
   */
      }
    }

    if(play)Component.ExpireSolution(true);


    foreach(CirclePack cp in circles)
    {
      if(cp.growing)
      {
        if(cp.edges() == true)
        {
          cp.growing = false; // cp.growing turns false cp.grow() will increase radius becomes blank fuction
        }
        else
        {

          foreach(CirclePack other in circles)
          {
            if(cp != other)
            {
              Circle cC = other.Show();
              Circle cB = cp.Show();
              double d = cB.Center.DistanceTo(cC.Center);

              if(d - growingSpeed < cC.Radius + cB.Radius)
              {
                cp.growing = false;
                break;
              }
            }
          }
        }
      }
      cR.Add(cp.Show()); //display each circle in the list
      cp.Grow(); //grow the circle
      if(cp.growing == false)
      {
        colorCircles.Add(cp.Show());
      }
    }




    circles_A = cR;
    swatch = colorCircles;
    C = rec;
    Component.Message = "Circle Packing";
# ---------- c_script: C# additional code ----------
  //CirclePack cp;
  List<CirclePack> circles; //new created class
  List<Circle> cR;
  Random rnd = new Random();

  class CirclePack
  {
    public double x; //x-coordinate for the circle
    public double y; // y coordinate for the circle
    public int width; //width of the rectangular boundary
    public int length; //length of the rectangular boundary
    public double r; //radius of circle
    public double growingSpeed;
    public bool growing = true; // wheather to stop growing or not

    //Constructor
    public CirclePack(double x_, double y_, int width_, int length_, double growingSpeed_)
    {
      x = x_;
      y = y_;
      width = width_;
      length = length_;
      r = 1;
      growingSpeed = growingSpeed_;
    }

    //Show circle method
    public Circle Show()
    {
      return new Circle(new Point3d(x, y, 0), r);
    }

    //grow the circle
    public void Grow()
    {
      if(growing){
        r = r + growingSpeed;
      }
    }

    //check edges of the boundary method (put the limitation on growing circle
    public bool edges()
    {
      return (x + r > length || x - r < (-length) || y + r > width || y - r < (-width));
    }
  }

  // function that check the each circles center point if its inside another circle
  CirclePack newCircle(int length, int width, double growingSpeed)
  {
    double y = rnd.Next(-width, width);
    double x = rnd.Next(-length, length);
    bool validCircle = true; // create bool for validity of circle
    foreach(CirclePack c in circles)
    {
      Circle ci = c.Show();
      double dist = ci.Center.DistanceTo(new Point3d(x, y, 0)); //get distance between random point and center of circle
      if(dist < ci.Radius) // if distance is less than the radius of circle turn valid circle false
      {
        validCircle = false;
        break;
      }
    }
    if(validCircle)
    {
      return new CirclePack(x, y, width, length, growingSpeed);
    }
    else
    {
      return null;
    }
  }
# ---------- end c_script ----------
