# Grasshopper definition DoublePendulum_simulation.gh (Grasshopper 1.0.7)

damping = Slider(1, range=0.0001..1)
c_script = CSharpScript(
    play=Toggle(False),
    iReset=Button(),
    L1=Slider(94.4828, range=0..200),
    L2=Slider(100, range=0..200),
    mass1=Slider(20, range=0..20),
    mass2=Slider(10, range=0..20),
    gravity=Slider(0.98, range=0..2),
    damping=damping)  # -> out, bob, pattern; inputs play: Boolean, iReset: Boolean, L1: Double, L2: Double, mass1: Double, mass2: Double, gravity: Double, damping: Double
# ---------- c_script: C# ----------
    List<object> obj = new List<object>();

    r1 = L1;
    r2 = L2;
    m1 = mass1;
    m2 = mass2;
    g = gravity;

    if(iReset)
    {
      a1 = Math.PI / 2;
      a2 = Math.PI / 2;

      a1_V = 0;
      a2_V = 0;
      tracePts = new List<Point3d>();
    }

    double num1 = -g * (2 * m1 + m2) * Math.Sin(a1);
    double num2 = -m2 * g * Math.Sin(a1 - 2 * a2);
    double num3 = -2 * Math.Sin(a1 - a2) * m2;
    double num4 = a2_V * a2_V * r2 + a1_V * a1_V * r1 * Math.Cos(a1 - a2);
    double denom = r1 * (2 * m1 + m2 - m2 * Math.Cos(2 * a1 - 2 * a2));

    double a1_A = (num1 + num2 + num3 * num4) / denom;


    num1 = 2 * Math.Sin(a1 - a2);
    num2 = a1_V * a1_V * r1 * (m1 + m2);
    num3 = g * (m1 + m2) * Math.Cos(a1);
    num4 = a2_V * a2_V * r2 * m2 * Math.Cos(a1 - a2);
    denom = r2 * (2 * m1 + m2 - m2 * Math.Cos(2 * a1 - 2 * a2));

    double a2_A = (num1 * (num2 + num3 + num4)) / denom;


    double x1 = r1 * Math.Sin(a1);
    double y1 = r1 * Math.Cos(a1);

    double x2 = x1 + r2 * Math.Sin(a2);
    double y2 = y1 + r2 * Math.Cos(a2);

    Line line1 = new Line(0, 0, 0, x1, y1, 0); obj.Add(line1);
    Sphere sph1 = new Sphere(new Point3d(x1, y1, 0), m1);  obj.Add(sph1);

    Line line2 = new Line(x1, y1, 0, x2, y2, 0); obj.Add(line2);
    Sphere sph2 = new Sphere(new Point3d(x2, y2, 0), m2); obj.Add(sph2);

    tracePts.Add(new Point3d(x2, y2, 0));

    a1_V += a1_A;
    a2_V += a2_A;

    a1 += a1_V;
    a2 += a2_V;

    //add damping
    a1_V *= damping;
    a2_V *= damping;

    if(play)
    {
      Component.ExpireSolution(true);
    }

    Curve c = null;
    if(tracePts.Count > 3)
    {
      c = Curve.CreateInterpolatedCurve(tracePts, 3);
    }

    bob = obj;
    pattern = c;

    Component.Message = "DoublePendulum";
# ---------- c_script: C# additional code ----------
  double r1;
  double r2;
  double m1;
  double m2;
  double a1 = Math.PI / 2;
  double a2 = Math.PI / 2;
  double g;

  double a1_V;
  double a2_V;


  List<Point3d> tracePts;
# ---------- end c_script ----------
preview = CustomPreview(Geometry=c_script.bob, Material=ColourSwatch(SwatchColor=RGB(0, 0, 0)))
