# Grasshopper definition 10_Fireworks.gh (Grasshopper 1.0.7)

fireworks = CSharpScript(iReset=Button(), iPlay=Toggle(False), frequency=Slider(0.16, range=0.01..0.75))  # -> out, A, B; inputs iReset: Boolean, iPlay: Boolean, frequency: Double
# ---------- fireworks: C# usings ----------
using System.IO;
using System.Linq;
using System.Data;
using System.Drawing;
using System.Reflection;
using System.Windows.Forms;
using System.Xml;
using System.Xml.Linq;
using System.Runtime.InteropServices;

using Rhino.DocObjects;
using Rhino.Collections;
using GH_IO;
using GH_IO.Serialization;

using Rhino.UI;
using Rhino.Display;
# ---------- fireworks: C# ----------
    // var eC = new System.Windows.Forms.MouseEventArgs();

    if(iReset)
    {
      fireWorks = new List<FireWorksSystem>();
    }
    if(iPlay)
      Component.ExpireSolution(true);

    if(rand.NextDouble() < frequency)
    {
      fireWorks.Add(new FireWorksSystem(rand.Next(10, 300)));
    }

    for (int i = fireWorks.Count - 1; i >= 0; i--)
    {
      FireWorksSystem fs = fireWorks[i];
      //Print(fs.Firework.Velocity.ToString());
      fs.Run();

      if (fs.Done())
        fireWorks.Remove(fs);
    }

    //    if(_points.Count >= 3)
    //    {
    //           Curve cvs = Curve.CreateInterpolatedCurve(_points, 3);
    //      B = cvs;
    //    }


    A = fireWorks;
# ---------- fireworks: C# additional code ----------
  //  Particle particle;
  List<FireWorksSystem> fireWorks;
  public static Random rand = new Random(Guid.NewGuid().GetHashCode());


  public static Vector3d GetRandomUnitVector() //random 3d vector on the sphere
  {
    // formula for random point on a sphere
    double phi = 2.0 * Math.PI * rand.NextDouble();
    double theta = Math.Acos(2.0 * rand.NextDouble() - 1.0);

    double x = Math.Sin(theta) * Math.Cos(phi);
    double y = Math.Sin(theta) * Math.Sin(phi);
    double z = Math.Cos(theta);

    return new Vector3d(x, y, z);
  }


  public static List<System.Drawing.Color> AllColors()
  {

    List<System.Drawing.Color> listOfDrawingColours = new List<System.Drawing.Color>();
    foreach(KnownColor color in Enum.GetValues(typeof(KnownColor)))
    {
      System.Drawing.Color col = System.Drawing.Color.FromKnownColor(color);
      if(col == Color.Black || col == Color.DarkGray)
        continue;
      listOfDrawingColours.Add(col);
    }
    return listOfDrawingColours;
  }


  #region Display Points,color etc.
  private BoundingBox _box;
  private static List<Point3d> _points;
  private static List<Color> _colors;
  private static List<Curve>_curves;

  //private static List<Point3d> pts = new List<Point3d>();

  public override void BeforeRunScript()
  {
    _points = new List<Point3d>();
    _colors = new List<Color>();
    _curves = new List<Curve>();
  }
  public override void AfterRunScript()
  {
    if (_points == null || _points.Count == 0)
      _box = BoundingBox.Empty;
    else
      _box = new BoundingBox(_points);

    foreach (IGH_Param param in Component.Params.Output)
    {
      IGH_PreviewObject pv = param as IGH_PreviewObject;
      if (pv != null)
        pv.Hidden = true;
    }
  }

  #endregion

  public override BoundingBox ClippingBox
  {
    get { return _box; }
  }

  public override void DrawViewportWires(IGH_PreviewArgs args)
  {
    if (_points != null)
      for (int i = 0; i < _points.Count; i++)
        args.Display.DrawPoint(_points[i], _colors[i]);

    if(_curves != null)
      for (int i = 0; i < _curves.Count; i++)
        args.Display.DrawCurve(_curves[i], Color.Yellow);
  }

  public double Remap(double val, double from1, double from2, double to1, double to2)
  {

    return to1 + (to2 - to1) * ((val - from1) / (from2 - from1));
  }

  public class Particle
  {
    // private static Random rand = new Random();
    //rand = new Random(Guid.NewGuid().GetHashCode());
    public static List<Color> allColors = AllColors();
    public int ColorIndex{get;set;}

    public Point3d Location { get; set; }
    public Vector3d Velocity { get; set; }
    public Vector3d Acceleration { get; set; }

    public int LifeSpan { get; set; }

    private bool seed = false;

    //public int Hu { get; set; }

    public Particle(double x, double y, int colorIndex)
    {
      this.ColorIndex = colorIndex;

      this.Acceleration = new Vector3d(0, 0, 0);
      this.Velocity = new Vector3d(0, 0, rand.Next(18, 25));
      this.Location = new Point3d(x, y, 0);

      this.seed = true;
      this.LifeSpan = 255;
    }

    public Particle(Point3d location, int colorIndex)
    {
      this.ColorIndex = colorIndex;
      this.Acceleration = new Vector3d(0, 0, 0);

      this.Velocity = GetRandomUnitVector();
      this.Velocity = Vector3d.Multiply(this.Velocity, rand.Next(5, 25));

      this.Location = new Point3d(location);
      this.LifeSpan = 255;

    }

    // Method to apply force
    public void ApplyForce(Vector3d force)
    {
      this.Acceleration = Vector3d.Add(this.Acceleration, force);
    }

    // Method to Update location
    public void Update()
    {
      this.Velocity = Vector3d.Add(this.Velocity, this.Acceleration);
      this.Location = this.Location + this.Velocity;

      if (!seed)
      {
        this.LifeSpan -= 5;
        this.Velocity = Vector3d.Multiply(this.Velocity, 0.95);
      }
      this.Acceleration = Vector3d.Multiply(this.Acceleration, 0);
    }

    // Method to Display particles
    public void Display()
    {

      if(this.LifeSpan < 1)
        this.LifeSpan = 0;
      if(this.LifeSpan > 255)
        this.LifeSpan = 255;
      Point3d pt = new Point3d(this.Location.X, this.Location.Y, this.Location.Z);
      Color myColor = Color.FromArgb(this.LifeSpan, Particle.allColors[this.ColorIndex]);
      _colors.Add(myColor);
      _points.Add(pt); //pts.Add(pt);
    }

    // Is the particle still usefull
    public bool IsDead()
    {
      if (this.LifeSpan < 1)
        return true;
      else
        return false;
    }

    //explode fire work true or false
    public bool Explode()
    {
      if (this.seed && this.Velocity.Z <= 0)
      {
        this.LifeSpan = 0;
        return true;
      }
      return false;
    }

    // Run the simulation
    public void Run()
    {
      Update();
      Display();
    }
  }

  public class FireWorksSystem
  {
    // private Random rand = new Random();
    private Vector3d Gravity = new Vector3d(0, 0, -0.25);
    public List<Particle> Particles { get; private set; }   // A list for all the particles
    public Particle Firework { get; private set; }
    public int ColorIndex { get; set; }
    public int Count{private get; set;}

    public FireWorksSystem(int count)
    {
      //this.initialPoints = new List<Point3d>();
      //      this.Hu = rand.Next(0, 255);
      this.Count = count;
      this.ColorIndex = rand.Next(0, Particle.allColors.Count);
      this.Firework = new Particle(rand.Next(0, 900), rand.Next(0, 900), this.ColorIndex);
      this.Particles = new List<Particle>();

    }

    public bool Done()
    {
      if (this.Firework == null && this.Particles.Count == 0)
        return true;
      else
        return false;
    }

    public void Run()
    {
      if (this.Firework != null)
      {
        this.Firework.ApplyForce(this.Gravity);
        this.Firework.Update();
        this.Firework.Display();

        if (this.Firework.Explode())
        {
          //List<Curve> _curves = new List<Curve>();

          for (int i = 0; i < this.Count; i++)
          {
            Particle parti = new Particle(this.Firework.Location, this.ColorIndex);
            this.Particles.Add(parti); // Add no. of particles here to see aftr explosion
          }
          this.Firework = null;
        }
      }

      for (int i = 0; i < this.Particles.Count; i++)
      {
        // DataTree<Point3d> pts = new DataTree<Point3d>();
        Particle p = this.Particles[i];
        p.ApplyForce(Gravity);
        p.Run();
        // pts.Add(p.Location,new GH_Path());

        //        if(pts.Count >= 3)
        //        {
        //          _curves.Add(Curve.CreateInterpolatedCurve(pts, 3));
        //        }
        if (p.IsDead())
          this.Particles.Remove(p);
      }
    }

    // A method to test if Particle system has still particles
    public bool Dead()
    {
      if (this.Particles.Count == 0)
        return true;
      else
        return false;
    }
  }
# ---------- end fireworks ----------

# ---- group: Set Color in Script
c_script = CSharpScript()  # -> out, A
# ---------- c_script: C# usings ----------
using System.IO;
using System.Linq;
using System.Data;
using System.Drawing;
using System.Reflection;
using System.Windows.Forms;
using System.Xml;
using System.Xml.Linq;
using System.Runtime.InteropServices;

using Rhino.DocObjects;
using Rhino.Collections;
using GH_IO;
using GH_IO.Serialization;
# ---------- c_script: C# ----------
    // Ok, just adding nonsense here cause I don't understand the nodes etc.
    var gradient = Grasshopper.GUI.Gradient.GH_Gradient.GreyScale();

    List<Point3d> pts = new List<Point3d>();
    int range = 256;
    for (int k = 0; k < range; k++)
    {
      pts.Add(new Point3d(0, 0, k));
      _points.Add(new Point3d(0, 0, k));

      double t = Remap(k, 0, range, 0, 1);
      Color myColor = Color.FromArgb(k, gradient.ColourAt(t));
      _colors.Add(myColor);
    }

    A = pts;
# ---------- c_script: C# additional code ----------
  #region display code
  private BoundingBox _box;
  private List<Point3d> _points;
  private List<Color> _colors;

  public override void BeforeRunScript()
  {
    _points = new List<Point3d>();
    _colors = new List<Color>();
  }
  public override void AfterRunScript()
  {
    if (_points == null || _points.Count == 0)
      _box = BoundingBox.Empty;
    else
      _box = new BoundingBox(_points);

    foreach (IGH_Param param in Component.Params.Output)
    {
      IGH_PreviewObject pv = param as IGH_PreviewObject;
      if (pv != null)
        pv.Hidden = true;
    }
  }

  #endregion

  public override BoundingBox ClippingBox
  {
    get { return _box; }
  }

  public override void DrawViewportWires(IGH_PreviewArgs args)
  {
    if (_points != null)
      for (int i = 0; i < _points.Count; i++)
        args.Display.DrawPoint(_points[i], _colors[i]);
  }

  public double Remap(double val, double from1, double from2, double to1, double to2)
  {

    return to1 + (to2 - to1) * ((val - from1) / (from2 - from1));
  }
# ---------- end c_script ----------
