# Grasshopper definition Flocking Simulation.gh (Grasshopper 0.9.76)

genes = GenePool(Decimals=4, Maximum=10, Minimum=0, Value=[9.3985, 4.2354, 10, 7.3671, 8.8795])
pt = Point([Point(-16.51082331, -7.91622567, 0), Point(-18.07341591, 50.21221889, 0), Point(41.61762125, 48.02458926, 0), Point(48.18051015, -9.791336785, 0), Point(15.67858416, 14.89762623, 0)])

# ---- group: Reset
button = Button()

# ---- group: 2d/3d
toggle = BooleanToggle(False)

# ---- group: Play
toggle_2 = BooleanToggle(False)

# ----
cir = Circle(Plane=pt, Radius=genes)
c_script = CSharpScript(
    iReset=button,
    No_of_Agents=Slider(608, range=0..5000),
    Timestep=Slider(0.078, range=0..2),
    alignmentStrength=Slider(3.487, range=0..100),
    neighbourhoodRadius=Slider(7.898, range=0..60),
    SeparatonDistance=Slider(6.2939, range=0..10),
    repellers=cir,
    is3D=toggle,
    play=toggle_2)  # -> out, A, B; inputs iReset: Boolean, No_of_Agents: Int32, Timestep: Double, alignmentStrength: Double, neighbourhoodRadius: Double, SeparatonDistance: Double, repellers: list, is3D: Boolean, play: Boolean
# ---------- c_script: C# ----------
    if(iReset || fS == null)
      fS = new FlockSystem(No_of_Agents, is3D, Timestep, alignmentStrength,
        neighbourhoodRadius, SeparatonDistance, repellers);

    else
    {
      fS.Update();

      if(play){
        Component.ExpireSolution(true); // once the slution is completed, component will run again

        //fS.AgentCount = No_of_Agents;
        fS.Timestep = Timestep;
        fS.AlignmentStrength = alignmentStrength;
        fS.NeighbourhoodRadius = neighbourhoodRadius;
        fS.SeparatonDistance = SeparatonDistance;
        fS.Repellers = repellers;

      }
    }



    List<GH_Point> position = new List<GH_Point>();
    List<GH_Vector> velocities = new List<GH_Vector>();

    foreach(FlockAgent agent in fS.Agents)
    {
      position.Add(new GH_Point(agent.Position));
      velocities.Add(new GH_Vector(agent.Velocity));
    }

    A = position;
    B = velocities;
    Component.Message = "Flocking Simulation";
# ---------- c_script: C# additional code ----------
  FlockSystem fS;


  //************************************************************************************************************
  public class FlockAgent ////////////////////////////
  {
    public Point3d Position; // Position of the agent
    public Vector3d Velocity; //velocity of the agent

    private Vector3d DesiredVelocity; // this is the velocity that agents wnats to achieve eventually

    //flocksystem variable is the refernce to the data
    // in order to get access to the parameters declared in FlockSYstem class
    public FlockSystem FlockSystem; // calling flocksystem class inside flockagent class

    //constructor take point and velocity
    public FlockAgent(Point3d position, Vector3d velocity)
    {
      Position = position;
      Velocity = velocity;
    }

    //the update function moves the point with specified velocity
    public void UpdateVelocityAndPosition()
    {
      Velocity = 0.97 * Velocity + 0.03 * DesiredVelocity;

      if(Velocity.Length > 6.0) Velocity *= 6.0 / Velocity.Length;
      else if(Velocity.Length < 2.0)Velocity *= 2.0 / Velocity.Length;

      Position += Velocity * FlockSystem.Timestep;
    }

    public void ComputeDesiredVelocity(List < FlockAgent > neighbours)
    {
      DesiredVelocity = new Vector3d(0, 0, 0);
      double boundingBoxSize = 30;

      if(Position.X < 0.0)
        DesiredVelocity += new Vector3d(-Position.X, 0, 0);

      else if(Position.X > boundingBoxSize)
        DesiredVelocity += new Vector3d(boundingBoxSize - Position.X, 0, 0);


      if(Position.Y < 0.0)
        DesiredVelocity += new Vector3d(0, -Position.Y, 0);

      else if(Position.Y > boundingBoxSize)
        DesiredVelocity += new Vector3d(0, boundingBoxSize - Position.Y, 0);

      if(Position.Z < 0.0)
        DesiredVelocity += new Vector3d(0, 0, -Position.Z);

      else if(Position.Z > boundingBoxSize)
        DesiredVelocity += new Vector3d(0, 0, boundingBoxSize - Position.Z);

      if(neighbours.Count == 0)
        DesiredVelocity += Velocity; //maintain the current velocity
      else
      {
        // ----------------------------------------
        //alignment behaviour
        // ---------------------------------------
        Vector3d alignment = Vector3d.Zero;

        foreach(FlockAgent ne in neighbours)
        {
          alignment += ne.Velocity;
        }
        alignment /= neighbours.Count;
        DesiredVelocity += FlockSystem.AlignmentStrength * alignment;

        //-----------------------------------------
        //"Cohesion Behavior
        //--------------------------------------

        Point3d center = Point3d.Origin;

        foreach(FlockAgent ne in neighbours )
        {
          center += ne.Position;
        }

        center /= neighbours.Count;
        Vector3d cohesion = center - Position;
        DesiredVelocity += FlockSystem.CohesionStrength * cohesion;
      }

      //-----------------------------------------
      //"Seperation Behavior
      //--------------------------------------
      Vector3d seperation = Vector3d.Zero;

      foreach(FlockAgent ne in neighbours)
      {
        double distanceToNeighbour = Position.DistanceTo(ne.Position);

        if(distanceToNeighbour < FlockSystem.SeparatonDistance)
        {
          Vector3d getAway = Position - ne.Position;
          seperation += getAway / (getAway.Length * distanceToNeighbour);
        }
      }
      DesiredVelocity += FlockSystem.SeparatonDistance * seperation;

      //Avoiding the obstacles (repellers)...........................

      foreach(Circle repeller in FlockSystem.Repellers)
      {
        double distanceToRepeller = Position.DistanceTo(repeller.Center);
        Vector3d repulsion = Position - repeller.Center;
        repulsion /= (repulsion.Length * distanceToRepeller);
        repulsion *= 30.0 * repeller.Radius;
        DesiredVelocity += repulsion;
      }
    }

  }


  //************************************************************************************************************
  public class FlockSystem /////////////////////////////////
  {
    public List<FlockAgent> Agents; // list of agents
    public int AgentCount;
    public double Timestep;
    public double NeighbourhoodRadius;
    public double FieldofView;
    public double AlignmentStrength;
    public double CohesionStrength;
    public double SeparatonDistance;
    public double MinSpeed;
    public double MaxSpeed;
    public List<Circle> Repellers;
    public bool UseRTree;
    public bool UseParallel;

    //Constructor takes number of agents and if bool value is agents move in 3d space or 2d space
    public FlockSystem(int agentCount, bool is3d, double TimeStep, double alignmentStrength,
      double neighbourhoodRadius, double separatonDistance, List<Circle> repellers)
    {
      AgentCount = agentCount;
      Timestep = TimeStep;
      AlignmentStrength = alignmentStrength;
      NeighbourhoodRadius = neighbourhoodRadius;
      SeparatonDistance = separatonDistance;
      Repellers = repellers;
      Agents = new List<FlockAgent>(); // assign list of agent to an empty list

      if(is3d) //if want 3D
      {
        for(int i = 0; i < AgentCount; i++) // iterate throught loop
        {
          FlockAgent agent = new FlockAgent(Util.GetRandomPoint(0, 60, 0, 60, 0, 60),
            Util.GetRandomUnitVector() * 2.0); // specify the location and velocity here using Util class

          agent.FlockSystem = this;//when inside function, using this this keyword will return the value of the current object runnning
          Agents.Add(agent); // add to the list
        }
      }
      else   // this for sinmulation in 2d space
      {
        for(int i = 0; i < agentCount; i++)
        {
          FlockAgent agent = new FlockAgent(Util.GetRandomPoint(0, 100, 0, 100, 0, 0),
            Util.GetRandomUnitVectorXY() * 2.0);

          agent.FlockSystem = this; //when inside function, using this this keyword will return the value of the current object runnning
          Agents.Add(agent); // add to the list
        }
      }
    }

    public void Update()  // updates each agents postion
    {
      foreach(FlockAgent agent in Agents)
      {
        List<FlockAgent> neighbours = FindNeighbours(agent);
        agent.ComputeDesiredVelocity(neighbours);
      }

      foreach(FlockAgent agent in Agents)
      {
        agent.UpdateVelocityAndPosition();
      }
    }

    public List<FlockAgent> FindNeighbours(FlockAgent agent)
    {
      List<FlockAgent> neighbours = new List<FlockAgent>();

      foreach(FlockAgent nb in Agents)
      {
        if(nb != agent && nb.Position.DistanceTo(agent.Position) < NeighbourhoodRadius)
        {
          neighbours.Add(nb);
        }
      }
      return neighbours;
    }
  }


  //************************************************************************************************************
  public static class Util //////////////////////////////
  {
    static Random random = new Random();

    public static Point3d GetRandomPoint(double minX, double maxX,
      double minY, double maxY,
      double minZ, double maxZ)
    {
      double x = minX + (maxX - minX) * random.NextDouble(); //random value in given range
      double y = minY + (maxY - minY) * random.NextDouble();
      double z = minZ + (maxZ = minZ) * random.NextDouble();

      return new Point3d(x, y, z);
    }

    public static Vector3d GetRandomUnitVectorXY()
    {
      double angle = 2.0 * Math.PI * random.NextDouble(); //random angle between 0 to 360

      double x = Math.Cos(angle);
      double y = Math.Sin(angle);

      return new Vector3d(x, y, 0.0);
    }

    public static Vector3d GetRandomUnitVector() //random 3d vector on the sphere
    {
      // formula for random point on a sphere
      double phi = 2.0 * Math.PI * random.NextDouble();
      double theta = Math.Acos(2.0 * random.NextDouble() - 1.0);

      double x = Math.Sin(theta) * Math.Cos(phi);
      double y = Math.Sin(theta) * Math.Sin(phi);
      double z = Math.Cos(theta);

      return new Vector3d(x, y, z);

    }
  }
# ---------- end c_script ----------
boundary = BoundarySurfaces(Edges=cir)
preview = CustomPreview(Geometry=boundary, Shader=ColourSwatch(SwatchColor=RGBA(255, 255, 255, 197)))
unit = UnitVector(Vector=c_script.B)
vdis = VectorDisplay(Anchor=c_script.A, Vector=unit)
