# Grasshopper definition Fractal Tree.gh (Grasshopper 0.9.76)

# ---- group: True to play
toggle = BooleanToggle(True)

# ----
timer = Timer(TimerInterval=1, Target=c_script)
c_script = CSharpScript(
    reset=toggle,
    branchScale=Slider(0.7064, range=0..1),
    branchNumber=Slider(7, range=1..10),
    length=Slider(10, range=0..10))  # -> out, A; inputs reset: Boolean, branchScale: Double, branchNumber: Int32, length: Double
# ---------- c_script: C# ----------
    x = x + aX;
    List<Line> lines = new List<Line>();
    if(x >= 180){
      aX = -1;
    }
    else if(x <= 0){
      double bAngRad = ((Math.PI / 180) * x);
      aX = 1;
    }

    if (reset == false)
    {
      lines.Add(new Line(new Point3d(0, 0, 0), new Vector3d(0, 1, 0), length * branchScale));
      x = 0;
      aX = 1;
      A = lines;
    }

    else
    {
      // set the branchAngle converting it from degrees to radians
      double bAngRad = ((Math.PI / 180) * x); // x is branch angle (changing between 0 to 180 forth and back)
      //Create a new line in Y direction from the origin and add it to the list
      lines.Add(new Line(new Point3d(0, 0, 0), new Vector3d(0, 1, 0), length * branchScale));

      //Create two temporary lists and set the first equal to the lines list
      List<Line> tempList = new List<Line>();
      List<Line> tempList2 = new List<Line>();
      tempList = lines;

      int i = 0;
      while (i < branchNumber)
      {
        tempList2 = CreateBranch(tempList, branchScale, bAngRad);
        tempList = tempList2;
        lines.AddRange(tempList2);
        i++;
      }
      A = lines;
    }
    Component.Message = "Fractal Tree";
# ---------- c_script: C# additional code ----------
  double x = 0;
  double aX = 1;

  public List<Line> CreateBranch (List<Line>lines, double bScale, double bAngle)
  {
    // get the length of the current trunk and create new scaled branch
    List<Line> newLines = new List<Line>();
    foreach(Line ln in lines)
    {
      // Get the length of the current trunk and create a new scaled branch
      double newLength = ln.Length * bScale;

      // get the endPoint of the trunk and its tangent vector
      Point3d endPt = ln.To;
      Vector3d unitTan = ln.UnitTangent;

      // create two new lines and make the second line have a negative rotation
      Line ln1 = new Line(endPt, unitTan, newLength);
      ln1.Transform(Rhino.Geometry.Transform.Rotation(bAngle, endPt));

      Line ln2 = new Line(endPt, unitTan, newLength);
      ln2.Transform(Rhino.Geometry.Transform.Rotation(-bAngle, endPt));

      // add these new branches to the list
      newLines.Add(ln1);
      newLines.Add(ln2);
    }
    return newLines;
  }
# ---------- end c_script ----------
panel = Panel(c_script.out)
