# Grasshopper definition Random_Walker.gh (Grasshopper 0.9.76)

# ---- group: Set to true
toggle = BooleanToggle(False)

# ----
timer = Timer(TimerInterval=20, Target=c_script)  # disabled
c_script = CSharpScript(Run=toggle, Rst=Button(), Len=Slider(2, range=0..2))  # -> out, A, B; inputs Run: Boolean, Rst: Boolean, Len: Double
# ---------- c_script: C# ----------
    if(Rst || counter == 0)
    {
      pts = new System.Collections.Generic.List<Point3d>(){new Rhino.Geometry.Point3d()};
      rnd = new System.Random();
      move = new Rhino.Geometry.Vector3d();
    }

    if (timer == null)
      FindTimer();

    // Assign random possibilities for moving the Point
    if(Run)
    {
      int r = rnd.Next(25);

      if(r == 0) move.X += 1; //1
      else if(r == 1) move.X += -1; //2
      else if(r == 2) move.Y += 1; //3
      else if(r == 3) move.Y += -1; //4
      else if(r == 4) move.Z += 1; //5
      else if (r == 5) move.Z += -1; //6
        //////////////////////////////////////////////////////////
      else if (r == 6) move += new Vector3d(1, 1, 0);//7
      else if (r == 7) move += new Vector3d(1, -1, 0);//8
      else if (r == 8) move += new Vector3d(-1, 1, 0);//9
      else if (r == 9) move += new Vector3d(-1, -1, 0);//10

        ////////////////////////////////////////////////////////
      else if (r == 10) move += new Vector3d(1, 0, 1);//11
      else if (r == 11) move += new Vector3d(1, 0, -1);//12
      else if (r == 12) move += new Vector3d(-1, 0, 1);//13
      else if (r == 13) move += new Vector3d(-1, 0, -1);//14

        ////////////////////////////////////////////////////////////
      else if (r == 14) move += new Vector3d(0, 1, 1);//15
      else if (r == 15) move += new Vector3d(0, -1, 1);//16
      else if (r == 16) move += new Vector3d(0, 1, -1);//17
      else if (r == 17) move += new Vector3d(0, -1, -1);//18

        /////////////////////////////////////////////////////////////
      else if (r == 18) move += new Vector3d(1, 1, 1); //19
      else if (r == 19) move += new Vector3d(-1, 1, 1); //20
      else if (r == 20) move += new Vector3d(1, -1, 1); //21
      else if (r == 21) move += new Vector3d(1, 1, -1); //22
      else if (r == 22) move += new Vector3d(-1, -1, 1);//23
      else if (r == 23) move += new Vector3d(-1, 1, -1);//24
      else if (r == 24) move += new Vector3d(1, -1, -1);//25
      else if (r == 25) move += new Vector3d(-1, -1, -1);//26

      move *= Len / move.Length;

      Point3d pt = pts.Last() + move;
      pts.Add(pt);
      counter++;
      if(timer.Locked) timer.Locked = false;
    }
    else
    {
      if(!timer.Locked) timer.Locked = true;
    }
    //curves.Add(Curve.CreateInterpolatedCurve(pts1, 3, CurveKnotStyle.Uniform));
    List<Curve> crvs = new List<Curve>();
    crvs.Add(Curve.CreateInterpolatedCurve(pts, 3, CurveKnotStyle.Uniform));
    //Rhino.Geometry.Polyline pl = new Polyline(pts);
    A = pts;
    //B = pl;
    B = crvs;
    Print(counter.ToString());
    Component.Message = "Random Walker";
# ---------- c_script: C# additional code ----------
  Rhino.Geometry.Vector3d move;
  System.Collections.Generic.List<Rhino.Geometry.Point3d> pts;
  System.Random rnd;
  System.Int32 counter;
  Grasshopper.Kernel.Special.GH_Timer timer;

  public void FindTimer()
  {
    // Find time in the IGH objects
    foreach(IGH_DocumentObject obj in GrasshopperDocument.Objects)
    {
      //if it is timer object do this
      if(obj is Grasshopper.Kernel.Special.GH_Timer)
      {
        // yes, it was, make sure we treat it like a Timer type:
        Grasshopper.Kernel.Special.GH_Timer tim = obj as Grasshopper.Kernel.Special.GH_Timer;

        // If this particular Timer ("tim") is connected to this
        // component (where this code resides), then assign that
        // Timer to the timer variable, and then quit ("return")
        if(tim.Targets.Contains(this.Component.InstanceGuid))
        {
          timer = tim;
          return;
        }
      }
    }
  }
# ---------- end c_script ----------
pt = Point(c_script.A)
crv = Curve(c_script.B)
