# Grasshopper definition Ray Casting.gh (Grasshopper 1.0.7)

# ---- group: Perline Noise
c_script = CSharpScript(
    iReset=Button(),
    iPlay=Toggle(True),
    castDensity=Slider(18, range=1..20),
    edgesCount=Slider(5, range=0..10),
    Reference=["C:\Users\Omkar\Documents\Visual Studio 2017\Projects\import libraries project\packages\MathNet.Numerics.4.7.0\lib\net40\MathNet.Numerics.dll", "C:\Users\Omkar\Documents\Visual Studio 2017\Projects\import libraries project\packages\SimplexNoise.2.0.0\lib\net45\SimplexNoise.dll"])  # -> out, A, B, C, D; inputs iReset: Boolean, iPlay: Boolean, castDensity: Int32, edgesCount: Int32
# ---------- c_script: C# usings ----------
using Rhino.UI;
using Rhino.Display;
using SimplexNoise;
# ---------- c_script: C# ----------
    lines = new List<Line>();
    pts = new List<Point3d>();

    int boundaryNos = edgesCount;

    xN += 0.01f;
    yN += 0.01f;

    double x = SimplexNoise.Noise.Calc1D(2, xN)[1];
    double y = SimplexNoise.Noise.Calc1D(2, yN)[1];

    if(iReset)
    {
      rnd = new Random();
      walls = new Boundary[boundaryNos];
      for (int i = 0; i < walls.Length; i++)
      {
        double x1 = rnd.Next(0, 1000);
        double x2 = rnd.Next(0, 1000);
        double y1 = rnd.Next(0, 1000);
        double y2 = rnd.Next(0, 1000);

        walls[i] = new Boundary(x1, y1, x2, y2);
      }

    }
    particle = new Particle(castDensity, x, y);



    //}
    if(iPlay)
    {
      Component.ExpireSolution(true);
    }

    foreach(Boundary wall in walls)
    {
      lines.Add(wall.Show()); //show walls
    }
    //mouse = TrackMouse();
    //particle.Update(mouse.X, mouse.Y);
    particle.Update(x, y);
    lines.AddRange(particle.Show());
    lines.AddRange(particle.Look(walls));





    A = lines;
    B = new Sphere(new Point3d(xN, yN, 0), 2.5);
    //    C = SimplexNoise.Noise.Calc1D(2, yN)[1];
    // D = xN;
    Component.Message = "2D-RayCasting";
# ---------- c_script: C# additional code ----------
  Boundary[] walls;
  Particle particle;
  List<Line> lines;
  List<Point3d> pts;
  Random rnd;

  float xN = 0.0f;
  float yN = 1000f;


  //Mouse tracking point class
  public static Point3d TrackMouse()
  {
    System.Drawing.Point screenPos = System.Windows.Forms.Cursor.Position;
    Rhino.RhinoDoc doc = Rhino.RhinoDoc.ActiveDoc;
    RhinoView view = doc.Views.ActiveView;
    System.Drawing.Point point = view.ActiveViewport.ScreenToClient(screenPos);
    Line line = view.ActiveViewport.ClientToWorld(point);
    Plane cPlane = view.ActiveViewport.ConstructionPlane();
    double t;
    Rhino.Geometry.Intersect.Intersection.LinePlane(line, cPlane, out t);
    return line.PointAt(t);
  }



  public class Boundary
  {
    public Point3d a;
    public Point3d b;

    public Boundary(double x1, double y1, double x2, double y2)
    {
      a = new Point3d(x1, y1, 0);
      b = new Point3d(x2, y2, 0);
    }

    public Line Show()
    {
      return new Line(a, b);
    }
  }


  public class Ray
  {
    Point3d pt;
    Vector3d dir;

    public Ray(Point3d pos, double angle)
    {
      pt = pos;

      //      static public PVector fromAngle(float angle, PVector target) {
      //        if (target == null) {
      //          target = new PVector((float) Math.cos(angle), (float) Math.sin(angle), 0);
      //        } else {
      //          target.set((float) Math.cos(angle), (float) Math.sin(angle), 0);
      //        }
      //        return target;
      //      }
      dir = new Vector3d(Math.Cos(angle * Math.PI / 180), Math.Sin(angle * Math.PI / 180), 0);

    }

    public void LookAt(double x, double y)
    {
      dir.X = x - pt.X;
      dir.Y = y - pt.Y;
      dir.Unitize();
    }

    public Line Show()
    {
      Transform move = Transform.PlaneToPlane(Plane.WorldXY, new Plane(pt, new Vector3d(0, 0, 1)));
      Line ln = new Line(new Point3d(0, 0, 0), dir, 10);
      ln.Transform(move);
      return ln;
    }

    //Look at wikipidia Line Line intersection
    public Point3d Cast(Boundary wall)
    {
      double x1 = wall.a.X;
      double y1 = wall.a.Y;
      double x2 = wall.b.X;
      double y2 = wall.b.Y;

      double x3 = pt.X;
      double y3 = pt.Y;
      double x4 = pt.X + dir.X;
      double y4 = pt.Y + dir.Y;

      //if the value of below formula is 0 then ray and boudary is perfectly parallel
      double den = (x1 - x2) * (y3 - y4) - (y1 - y2) * (x3 - x4); //formula
      if(den == 0)
      {
        //Print("Line is Parallel");
        return Point3d.Unset;
      }

      double t = ((x1 - x3) * (y3 - y4) - (y1 - y3) * (x3 - x4)) / den;
      double u = -((x1 - x2) * (y1 - y3) - (y1 - y2) * (x1 - x3)) / den;

      if(t > 0 && t < 1 && u > 0)
      {
        double ptx = x1 + t * (x2 - x1);
        double pty = y1 + t * (y2 - y1);
        return new Point3d(ptx, pty, 0);
      }
      else
        return Point3d.Unset;
    }
  }



  class Particle
  {
    public Point3d pos;
    public List<Ray> rays;

    //    public Mouse mouse;

    public Particle(int density, double x, double y)
    {

      pos = new Point3d(x, y, 0);
      rays = new List<Ray>();

      for (int i = 0; i < 360; i += density)
      {
        double angle = i;
        rays.Add(new Ray(pos, angle));
      }
    }



    public List<Line> Show()
    {
      List<Line> lines = new List<Line>();
      foreach(Ray r in rays)
      {
        lines.Add(r.Show());
      }
      return lines;
    }


    public List<Line> Look(Boundary[] walls)
    {
      List<Line> lines = new List<Line>();
      // List<double> distances = new List<double>();
      foreach(Ray r in rays)
      {
        Point3d closestPt = Point3d.Unset;
        double record = double.MaxValue;
        foreach(Boundary wall in walls)
        {
          // distances.Add(record);
          Point3d pt = r.Cast(wall);
          if(pt != Point3d.Unset)
          {
            double dist = pos.DistanceTo(pt); //distances.Add(record);
            if(dist < record)
            {
              record = dist;
              closestPt = pt;
            }
          }
        }
        if(closestPt != Point3d.Unset)
        {
          lines.Add(new Line(pos, closestPt));
        }
      }
      return lines;
    }



    public void Update(double x, double y)
    {
      this.pos.X = x;
      this.pos.Y = y;
    }

  }
# ---------- end c_script ----------

# ---- group: Track Mouse
c_script_2 = CSharpScript(
    iReset=Button(),
    iPlay=Toggle(False),
    castDensity=Slider(18, range=1..20),
    edgesCount=Slider(5, range=0..10),
    Reference=["C:\Users\Omkar\Documents\Visual Studio 2017\Projects\import libraries project\packages\MathNet.Numerics.4.7.0\lib\net40\MathNet.Numerics.dll", "C:\Users\Omkar\Documents\Visual Studio 2017\Projects\import libraries project\packages\SimplexNoise.2.0.0\lib\net45\SimplexNoise.dll"])  # -> out, A, B, C; inputs iReset: Boolean, iPlay: Boolean, castDensity: Int32, edgesCount: Int32
# ---------- c_script_2: C# ----------
    lines = new List<Line>();
    pts = new List<Point3d>();

    int boundaryNos = edgesCount;

    if(iReset)
    {
      rnd = new Random();
      walls = new Boundary[boundaryNos];
      for (int i = 0; i < walls.Length; i++)
      {
        double x1 = rnd.Next(0, 1000);
        double x2 = rnd.Next(0, 1000);
        double y1 = rnd.Next(0, 1000);
        double y2 = rnd.Next(0, 1000);

        walls[i] = new Boundary(x1, y1, x2, y2);
      }

    }
    particle = new Particle(castDensity);



    //}
    if(iPlay)
    {
      Component.ExpireSolution(true);
    }

    foreach(Boundary wall in walls)
    {
      lines.Add(wall.Show()); //show walls
    }
    mouse = TrackMouse();
    particle.Update(mouse.X, mouse.Y);
    lines.AddRange(particle.Look(walls));

    lines.AddRange(particle.Show());


    A = lines;
    B = new Sphere(mouse, 2.5);

    Component.Message = "2D-RayCasting";
# ---------- c_script_2: C# additional code ----------
  Boundary[] walls;
  Particle particle;
  Point3d mouse;
  List<Line> lines;
  List<Point3d> pts;
  Random rnd;

  //Mouse tracking point class
  public static Point3d TrackMouse()
  {
    System.Drawing.Point screenPos = System.Windows.Forms.Cursor.Position;
    Rhino.RhinoDoc doc = Rhino.RhinoDoc.ActiveDoc;
    RhinoView view = doc.Views.ActiveView;
    System.Drawing.Point point = view.ActiveViewport.ScreenToClient(screenPos);
    Line line = view.ActiveViewport.ClientToWorld(point);
    Plane cPlane = view.ActiveViewport.ConstructionPlane();
    double t;
    Rhino.Geometry.Intersect.Intersection.LinePlane(line, cPlane, out t);
    return line.PointAt(t);
  }



  public class Boundary
  {
    public Point3d a;
    public Point3d b;

    public Boundary(double x1, double y1, double x2, double y2)
    {
      a = new Point3d(x1, y1, 0);
      b = new Point3d(x2, y2, 0);
    }

    public Line Show()
    {
      return new Line(a, b);
    }
  }


  public class Ray
  {
    Point3d pt;
    Vector3d dir;

    public Ray(Point3d pos, double angle)
    {
      pt = pos;

      //      static public PVector fromAngle(float angle, PVector target) {
      //        if (target == null) {
      //          target = new PVector((float) Math.cos(angle), (float) Math.sin(angle), 0);
      //        } else {
      //          target.set((float) Math.cos(angle), (float) Math.sin(angle), 0);
      //        }
      //        return target;
      //      }
      dir = new Vector3d(Math.Cos(angle * Math.PI / 180), Math.Sin(angle * Math.PI / 180), 0);

    }

    public void LookAt(double x, double y)
    {
      dir.X = x - pt.X;
      dir.Y = y - pt.Y;
      dir.Unitize();
    }

    public Line Show()
    {
      Transform move = Transform.PlaneToPlane(Plane.WorldXY, new Plane(pt, new Vector3d(0, 0, 1)));
      Line ln = new Line(new Point3d(0, 0, 0), dir, 10);
      ln.Transform(move);
      return ln;
    }

    //Look at wikipidia Line Line intersection
    public Point3d Cast(Boundary wall)
    {
      double x1 = wall.a.X;
      double y1 = wall.a.Y;
      double x2 = wall.b.X;
      double y2 = wall.b.Y;

      double x3 = pt.X;
      double y3 = pt.Y;
      double x4 = pt.X + dir.X;
      double y4 = pt.Y + dir.Y;

      //if the value of below formula is 0 then ray and boudary is perfectly parallel
      double den = (x1 - x2) * (y3 - y4) - (y1 - y2) * (x3 - x4); //formula
      if(den == 0)
      {
        //Print("Line is Parallel");
        return Point3d.Unset;
      }

      double t = ((x1 - x3) * (y3 - y4) - (y1 - y3) * (x3 - x4)) / den;
      double u = -((x1 - x2) * (y1 - y3) - (y1 - y2) * (x1 - x3)) / den;

      if(t > 0 && t < 1 && u > 0)
      {
        double ptx = x1 + t * (x2 - x1);
        double pty = y1 + t * (y2 - y1);
        return new Point3d(ptx, pty, 0);
      }
      else
        return Point3d.Unset;
    }
  }



  class Particle
  {
    public Point3d pos;
    public List<Ray> rays;

    //    public Mouse mouse;

    private double width = TrackMouse().X;
    private double length = TrackMouse().Y;

    public Particle(int density)
    {

      pos = new Point3d(width, length, 0);
      rays = new List<Ray>();

      for (int i = 0; i < 360; i += density)
      {
        double angle = i;
        rays.Add(new Ray(pos, angle));
      }
    }



    public List<Line> Show()
    {
      List<Line> lines = new List<Line>();
      foreach(Ray r in rays)
      {
        lines.Add(r.Show());
      }
      return lines;
    }


    public List<Line> Look(Boundary[] walls)
    {
      List<Line> lines = new List<Line>();
      // List<double> distances = new List<double>();
      foreach(Ray r in rays)
      {
        Point3d closestPt = Point3d.Unset;
        double record = double.MaxValue;
        foreach(Boundary wall in walls)
        {
          // distances.Add(record);
          Point3d pt = r.Cast(wall);
          if(pt != Point3d.Unset)
          {
            double dist = pos.DistanceTo(pt); //distances.Add(record);
            if(dist < record)
            {
              record = dist;
              closestPt = pt;
            }
          }
        }
        if(closestPt != Point3d.Unset)
        {
          lines.Add(new Line(pos, closestPt));
        }
      }
      return lines;
    }



    public void Update(double x, double y)
    {
      this.pos.X = x;
      this.pos.Y = y;
    }

  }
# ---------- end c_script_2 ----------

# ----
panel = Panel(c_script.out)
