# Grasshopper definition TheCardioid.gh (Grasshopper 1.0.7)

c_script = CSharpScript(iReset=Button(), iPlay=Toggle(True))  # -> out, A, B, C; inputs iReset: Boolean, iPlay: Boolean
# ---------- c_script: C# ----------
    List<Point3d> pts = new List<Point3d>();
    List<Line> lines = new List<Line>();
    if(iReset)
    {
      factor = 0.0;
    }
    if(iPlay)
    {
      Component.ExpireSolution(true);
    }
    // double delta = 2 * Math.PI / divideTotal;
    r = 100; factor += 0.01;

    Circle cir = new Circle(Plane.WorldXY, r);
    for (int i = 0; i < divideTotal; i++)
    {
      //      double angle = Remap(i, 0, divideTotal, 0, Math.PI * 2);
      //      Print(angle.ToString());
      //      double x = r * Math.Cos(angle);
      //      double y = r * Math.Sin(angle);
      Vector3d v = getVector(i);
      pts.Add(new Point3d(v.X * r, v.Y * r, 0));

    }

    for (int i = 0; i < divideTotal; i++)
    {
      Vector3d a = getVector(i);
      Vector3d b = getVector(i * factor);
      lines.Add(new Line(new Point3d(a.X * r, a.Y * r, 0), new Point3d(b.X * r, b.Y * r, 0)));
    }
    A = pts;
    B = cir;
    C = lines;
# ---------- c_script: C# additional code ----------
  int divideTotal = 200;
  double factor = 0.0;
  double r;

  public double Remap(double val, double from1, double from2, double to1, double to2)
  {

    return to1 + (to2 - to1) * ((val - from1) / (from2 - from1));
  }

  public Vector3d getVector(double index)
  {
    double angle = Remap(index % divideTotal, 0, divideTotal, 0, Math.PI * 2);
    Vector3d vec = new Vector3d(Math.Cos(angle), Math.Sin(angle), 0);
    vec.Unitize();
    Vector3d.Multiply(vec, r);
    return vec;
  }
# ---------- end c_script ----------
